# Dynamo graph Baeume.dyn (Dynamo 2.0.2.6826)
# Platziert zwei Baeume

code_block = CodeBlock()
# ---------- code_block.designscript (5 lines) ----------
p=Point.ByCoordinates(10,20);
p1=Point.ByCoordinates(25,30);
t=FamilyType.ByName("3D Baum - rund");
FamilyInstance.ByPoint(t,p);
FamilyInstance.ByPoint(t,p1);
# ----------------------------------------
